# Grasshopper definition NOGrasshopperUtil.gh (Grasshopper 0.9.62)
# Copyright: Nono 2013

# CRV: Line With Center, Direction, Length
pt = ConstructPoint(XCoordinate=0, YCoordinate=0, ZCoordinate=0)
thickness = Slider(0.005, range=0..0.01)
# CRV: Thicken With Offset Thickness
crv = Curve(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)
# NOGrasshopperUtil
# 
# Developed by Nono Martínez Alonso (@nonoesp)
# LIST: Remove List Extremes
panel = Panel("1,2,3,4,5,6,7")
split = TextSplit(Text=panel, Separators=",")

start = Slider(1, range=0..10)
end = Slider(1, range=0..10)
remove_extremes = RemoveExtremes(list=split, start=start, end=end)
cluster = Cluster(center=pt, direction=Vector(0, 0, 1), length=Slider(0.06, range=0..0.1))
cluster_2 = Cluster_2(crv=crv, D=thickness)

panel_2 = Panel(remove_extremes)

# ==== cluster RemoveExtremes
end = ClusterInput()
start = ClusterInput()
list = ClusterInput()
lng = ListLength(List=list)
subtraction = Subtraction(A=lng, B=Slider(1, range=0..10))
subtraction_2 = Subtraction(A=subtraction, B=end)
dom = ConstructDomain(DomainStart=start, DomainEnd=subtraction_2)
subset = SubList(List=list, Domain=dom, Wrap=True)  # -> List, Index
sublist = ClusterOutput(subset.List)

# ==== cluster Cluster
center = ClusterInput()
direction = ClusterInput()
length = ClusterInput()
division = Division(A=length, B="2")
neg = Negative(Value=division)
line = LineSDL(Start=graft(center), Direction=direction, Length=[division, neg])  # -> flatten(Line)
join = JoinCurves(Curves=line, Preserve=False)
C = ClusterOutput(join)

# ==== cluster Cluster_2
D = ClusterInput()
crv = ClusterInput()
crv_2 = Curve(crv)
offset = Offset(Curve=crv_2, Distance=D, Plane=PlaneXY(0, 0, 0), Corners=1)
end = EndPoints(Curve=[offset, crv_2])  # -> Start, End
pline = PolyLine(Vertices=flatten(end.End), Closed=False)
pline_2 = PolyLine(Vertices=flatten(end.Start), Closed=False)
join = JoinCurves(Curves=[pline_2, offset, pline, crv_2], Preserve=False)
C = ClusterOutput(join)
